# Grasshopper definition truss_set.gh (Grasshopper 0.9.76)
# plug-ins: Python Interpreter

python = PythonScript(x=Slider(13, range=0..40), y=Slider(1, range=0..10), z=Slider(1.57, range=0..10), segments=Slider(5, range=0..10))  # -> out, a, b, c, d, e
# ---------- python: Python ----------
import rhinoscriptsyntax as rs
import Rhino as rc

#Criar classe Line, Divide, Move, Bars, etc, instanciar no for

i = 0
listLine = []
for i in range(4):
    line = rs.AddLine((0,y,0),(x,y,0))
    listLine.append(line)
    i += 1
print listLine
a = listLine[0]

#divide linha
i = 0
listDivide = []
for i in range(4):
    divide = rs.DivideCurve(listLine[i], segments, create_points=False, return_points=True)
    listDivide.append(divide)
    i += 1

point = listDivide[1]
b = point[1]

#move pontos
i = 0
listMoveSup = []
listMoveInf = []
for i in range(4):
    myVector1 = rc.Geometry.Vector3d(0,0,z)
    move1 = b + myVector1 #b (pq listDivide devolve uma lista, precisa escolher uma linha e depois escolher um ponto dessa linha, seguir..)
    listMoveSup.append(move1)
    myVector2 = rc.Geometry.Vector3d(0,0,-z)
    move2 = b + myVector2
    listMoveInf.append(move2)
c = listMoveSup[0]
d = listMoveInf[0]

#bars
i = 0
bars = []
for i in range(4):
    bar = rs.AddLine(listMoveSup[i], listMoveInf[i])
    bars.append(bar)
    i += 1
e = bars[0]
# ---------- end python ----------
panel = Panel(python.out)
python_2 = PythonScript()  # -> out, a, b, c, d
# ---------- python_2: Python ----------
import rhinoscriptsyntax as rs
import Rhino as rc

def LinhaMestre(start, end):
    """constroir linha"""
    return rs.AddLine(start, end)

def DivideLinha(curve_id, segments, create_points=False, return_points=True):
    """divide linha"""
    return rs.DivideCurve(curve_id, segments, create_points=False, return_points=True)

def EscolhaPonto(lista, ponto):
    """criar função para esta escolha também"""
    escolherLista = lista
    x, y = escolherLista[ponto], escolherLista[- ponto - ponto]
    return x, y

def MoverPontos(ponto_escolhido, z):
    """Move pontos"""
    myVector = rc.Geometry.Vector3d(0,0,z)
    x, y = ponto_escolhido + myVector, ponto_escolhido - myVector
    return x, y           #ele negativa todos os valores do ponto, deslocando para mais de uma direção

#a = LinhaMestre((0,0,0),(0,10,0))
#b = DivideLinha(a, 3)             #segments(número de segmentos que queremos dividir
#c = MoverPontos(b[0], 2)          #ponto escolhido e valor de z

#funções criadas, agora basta construir nossa treliça, fazemos isso chamando nossas funções

i = 0

a = []
b = [] # 4 listas de pontos, uma para cada linha
c = []
d = []

for i in range(4):
    linhas = LinhaMestre((0,i,0),(10,i,0))
    a.append(linhas)
    divideLinhas = DivideLinha(a[i], 6)
    b.append(divideLinhas)
    escolhePontos = EscolhaPonto(b[i], 1)
    c.append(escolhePontos)
    #movePontos = MoverPontos(c[i], 3)
    #d.append(moverPontos)
    i += 1
d = c[0] # c é tupla e não um único ponto, erro na função Mover
# ---------- end python_2 ----------
pt = Point(python.d)
pt_2 = Point(python.c)
line = Line(python.a)
geo = Geometry(python.e)
panel_2 = Panel(python_2.c)
